# Grasshopper definition tracking.gh (Grasshopper 1.0.8)
# plug-ins: RhinoCodePluginGH, Portal

udp = UdpReceiver(Port="5000", Start=Toggle(True))
base_station_mesh = Mesh(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)
tracker_mesh = Mesh(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)
data = Data(null)
py3 = Python3Script(data=udp, tracker_mesh=tracker_mesh, base_station_mesh=base_station_mesh)  # -> a, b, c, d, e; inputs tracker_mesh: Mesh, base_station_mesh: Mesh
# ---------- py3: Python ----------
import json
import Rhino.Geometry as rg


def quaternion_to_rotation_matrix(quaternion):
    if not isinstance(quaternion, (list, tuple)) or len(quaternion) != 4:
        raise ValueError(f"Invalid quaternion format: {quaternion}. Expected a list or tuple of 4 numbers.")
    
    w, x, y, z = quaternion
    rotation_matrix = [
        [1 - 2 * (y**2 + z**2), 2 * (x * y - z * w), 2 * (x * z + y * w)],
        [2 * (x * y + z * w), 1 - 2 * (x**2 + z**2), 2 * (y * z - x * w)],
        [2 * (x * z - y * w), 2 * (y * z + x * w), 1 - 2 * (x**2 + y**2)]
    ]
    return rotation_matrix


data_bytes = bytearray(data)
json_string = data_bytes.decode("utf-8")
parsed_json = json.loads(json_string)

device_serials = []
positions = []
quaternions = []

for device_serial, values in parsed_json.items():
    device_serials.append(values["device_serial"])
    positions.append(values["position"])
    quaternions.append(values["quaternion"])

planes = []

for serial, position, quaternion in zip(device_serials, positions, quaternions):
    try:
        rotation_matrix = quaternion_to_rotation_matrix(quaternion)
        
        x_axis = rg.Vector3d(*rotation_matrix[0])  
        y_axis = rg.Vector3d(*rotation_matrix[1])
        z_axis = rg.Vector3d(*rotation_matrix[2])

        # Adjust the axes based on the coordinate system differences:
        y_axis, z_axis = z_axis, -y_axis

        x_axis.Unitize()
        y_axis.Unitize()
        z_axis.Unitize()

        position_mm = [position[0] * 1000, -position[2] * 1000, position[1] * 1000]  # Convert to mm directly
        origin = rg.Point3d(*position_mm)  
        plane = rg.Plane(origin, x_axis, y_axis)
        planes.append(plane)
    except Exception as e:
        print(f"Error processing device {serial}: {e}")

transformed_mesh = None
base_station_planes = []
transformed_base_station_meshes = []

try:
    if "LHR-D61E634E" in device_serials:
        tracker_index = device_serials.index("LHR-D61E634E")
        
        tracker_plane = planes[tracker_index]
        
        source_plane = rg.Plane.WorldXY
        
        transformation = rg.Transform.PlaneToPlane(source_plane, tracker_plane)
        
        transformed_mesh = tracker_mesh.Duplicate()
        transformed_mesh.Transform(transformation)
        
        base_station_ids = ["LHB-12CD2DC1", "LHB-803AC526"]
        for base_id in base_station_ids:
            if base_id in device_serials:
                base_index = device_serials.index(base_id)
                base_station_plane = planes[base_index]
                base_station_planes.append(base_station_plane)
                
                base_station_transformation = rg.Transform.PlaneToPlane(source_plane, base_station_plane)
                
                transformed_base_station_mesh = base_station_mesh.Duplicate()  
                transformed_base_station_mesh.Transform(base_station_transformation)
                transformed_base_station_meshes.append(transformed_base_station_mesh)
                
    else:
        print("Tracker ID 'LHR-D61E634E' not found in device serials.")
        
except Exception as e:
    print(f"Error processing planes: {e}")

a = transformed_mesh       # The transformed mesh based on the tracker (if matched)
b = base_station_planes    # Planes for the base stations (both base stations have same geometry)
c = device_serials         # List of device serials for debugging
d = planes                 # All generated planes (tracker + base stations)
e = transformed_base_station_meshes
# ---------- end py3 ----------
toggle = BooleanToggle(False)
pln = Plane(py3.b)
